# Requirement set robotBuilder (R2024b)

## 1 [#2] Support incremental construction

### 1.1 [#6] Support parent-child relationships

#### 1.1.1 [#22] URDFTag should be able to add a child tag with unique name

#### 1.1.2 [#24] URDFTag should be able to remove a child tag by name

#### 1.1.3 [#25] URDFTag should be able to find a child by type or name or both

#### 1.1.4 [#20] URDFTag subclass should provide a list of valid child types

#### 1.1.5 [#21] addChild should throw an error if it cannot add a child

#### 1.1.6 [#12] Link is a valid child of a Robot

#### 1.1.7 [#13] Joint is a valid child of a Robot

#### 1.1.8 [#14] Material is a valid child of a Robot

#### 1.1.9 [#15] Visual is a valid child of a Link

#### 1.1.10 [#16] Geometry is a valid child of a Visual

#### 1.1.11 [#17] Origin is a valid child of a Visual

#### 1.1.12 [#18] Origin is a valid child of a Joint

### 1.2 [#7] Support reusable components

## 2 [#3] Validate structure

### 2.1 [#8] Each element should be a valid URDF tag or attribute

### 2.2 [#9] Each element tag must have a unique name

### 2.3 [#11] Each element tag must have a type attribute

### 2.4 [#10] Element tags can have at most one parent

## 3 [#4] Support import from urdf files

## 4 [#5] Support export to urdf file

## 5 [#19] Support all valid URDF tags